# Dynamo graph sample01.dyn (Dynamo 1.2.0.2690)

code_block = CodeBlock { 0; 12; }
create = Colibri.Dynamo.Domain.Create(code_block.out0, code_block.out1)
code_block_2 = CodeBlock { 0; 23; }
create_2 = Colibri.Dynamo.Domain.Create(code_block_2.out0, code_block_2.out1)
create_3 = List.Create(create, create_2)
code_block_3 = CodeBlock { {10,10}; }
boolean = BoolSelector(true)
iterate = Colibri.Dynamo.Iterator.Iterate(create_3, code_block_3, boolean)
watch = Watch(iterate)
